# Grasshopper definition san.gh (Grasshopper 1.0.4)
# plug-ins: Firefly.Core

ports_available = COMPortsAvailable()
panel = Panel(ports_available)
open_port = OpenClosePort(OpenClosePort=Toggle(True), PortNumber="6", BaudRate="9600")
read = SerialReadGeneric(StartReadingValues=Toggle(True), PortNumber="6")  # -> SerialOutput, StatusMessage
panel_2 = Panel(read.SerialOutput)
panel_3 = Panel(read.StatusMessage)
panel_4 = Panel(open_port)
